# Grasshopper definition rhino_animation.gh (Grasshopper 1.0.7)
# plug-ins: Anemone, HFTidyCanvas, CORE.Toolbox.Grasshopper, BullAnt

panel = Panel("""Plugins
- Elefront
- TTtoolbox
- Bullant (GeometryGym)""")
folder_path = DataDescription("C:\Users\mbide\Desktop\AECtech Hackaton\")
concat = Concatenate(FragmentA=folder_path, FragmentB="geometry.xlsx")
concat_2 = Concatenate(FragmentA=folder_path, FragmentB="geometry.xlsx")
concat_3 = Concatenate(FragmentA=folder_path, FragmentB="geometry.xlsx")
concat_4 = Concatenate(FragmentA=folder_path, FragmentB="geometry.xlsx")
concat_5 = Concatenate(FragmentA=folder_path, FragmentB="TimeHistoryDispOutput.xlsx")
xl_in = ReadFromExcel(WorkbookFilepath=concat, WorksheetName="Point Object Connectivity", Range="4", Live=False, Stream=Toggle(True))
storey_height = Pts("3.6")
xl_in_2 = ReadFromExcel(WorkbookFilepath=concat_4, WorksheetName="Beam Object Connectivity", Range="4", Live=False, Stream=Toggle(True))
xl_in_3 = ReadFromExcel(WorkbookFilepath=concat_3, WorksheetName="Column Object Connectivity", Range="4", Live=False, Stream=Toggle(True))
xl_in_4 = ReadFromExcel(WorkbookFilepath=concat_2, WorksheetName="Brace Object Connectivity", Range="4", Live=False, Stream=Toggle(True))
xl_in_5 = ReadFromExcel(WorkbookFilepath=concat_5, WorksheetName="Time History Plot", Range="4", Live=False, Stream=Toggle(True))
time_step = Pts("0.1")
xl_in_6 = ReadFromExcel(
    WorkbookFilepath="C:\Users\mbide\Desktop\AECtech Hackaton\FrameSec.xlsx",
    WorksheetName="frameSec",
    Range="4",
    Live=False,
    Stream=Toggle(True))
flip = FlipMatrix(Data=xl_in)
flip_2 = FlipMatrix(Data=xl_in_4)
flip_3 = FlipMatrix(Data=xl_in_3)
flip_4 = FlipMatrix(Data=xl_in_2)
flip_5 = FlipMatrix(Data=xl_in_6)
replace = ReplaceItems(List=xl_in_5, Item="0", Indices="0", Wrap=False)
split = SplitList(List=flip, Index="3")  # -> ListA, ListB
split_2 = SplitList(List=flip_2, Index="3")  # -> ListA, ListB
split_3 = SplitList(List=flip_3, Index="3")  # -> ListA, ListB
split_4 = SplitList(List=flip_4, Index="3")  # -> ListA, ListB
split_5 = SplitList(List=flip_5, Index="1")  # -> ListA, ListB
flip_6 = FlipMatrix(Data=split.ListB)
flip_7 = FlipMatrix(Data=replace)
flip_8 = FlipMatrix(Data=split_2.ListB)
flip_9 = FlipMatrix(Data=split_3.ListB)
flip_10 = FlipMatrix(Data=split_4.ListB)
flip_11 = FlipMatrix(Data=split_5.ListB)
item = ListItem(List=flip_6, Index="0", Wrap=True)
item_2 = ListItem(List=flip_6, Index="6", Wrap=True)
item_3 = ListItem(List=flip_6, Index="7", Wrap=True)
item_4 = ListItem(List=flip_6, Index="5", Wrap=True)
split_6 = SplitList(List=flip_7, Index="3")  # -> ListA, ListB
panel_2 = Panel("""15
16
29
30
31
32
33
34""")
item_5 = ListItem(List=flip_11, Index="0", Wrap=True)
item_6 = ListItem(List=flip_9, Index="3", Wrap=True)
item_7 = ListItem(List=flip_9, Index="4", Wrap=True)
item_8 = ListItem(List=flip_11, Index="1", Wrap=True)
item_9 = ListItem(List=flip_9, Index="0", Wrap=True)
item_10 = ListItem(List=flip_8, Index="4", Wrap=True)
item_11 = ListItem(List=flip_10, Index="3", Wrap=True)
item_12 = ListItem(List=flip_8, Index="3", Wrap=True)
item_13 = ListItem(List=flip_10, Index="4", Wrap=True)
item_14 = ListItem(List=flip_8, Index="0", Wrap=True)
item_15 = ListItem(List=flip_10, Index="0", Wrap=True)
node_y_coord = DataDescription(flatten(item_2))
node_x_coord = DataDescription(flatten(item_4))
node_z_coord = DataDescription(flatten(item_3))
displ_of_each_floor_in_mm = Pts(split_6.ListB)
node_num = DataDescription(flatten(item))
beam_num = Pts(item_5)
node2 = Pts(item_7)
profile = Pts(item_8)
node1 = Pts(item_6)
node1_2 = Pts(item_12)
beam_num_2 = Pts(item_14)
beam_num_3 = Pts(item_9)
beam_num_4 = Pts(item_15)
node2_2 = Pts(item_10)
node1_3 = Pts(item_11)
node2_3 = Pts(item_13)
pt = ConstructPoint(XCoordinate=node_x_coord, YCoordinate=node_y_coord, ZCoordinate=node_z_coord)
node_num_to_delete = NodeNum(panel_2)
node_num_2 = NodeNum(flatten(node_num))
pts_in_ft = NodeNum(pt)
node_num_3 = NodeNum(node_num)
mindex = MemberIndex(Set=node_num_2, Member=node_num_to_delete)  # -> flatten(Index), Count
node2_4 = Node2(node2_2)
beam_num_5 = BeamNum(beam_num_3)
node1_4 = Node1(node1_2)
node2_5 = Node2(node2)
beam_num_6 = BeamNum(beam_num_4)
beam_num_7 = BeamNum(beam_num_2)
node2_6 = Node2(node2_3)
node1_5 = Node1(node1)
node1_6 = Node1(node1_3)
multiplication = Multiplication(A=pts_in_ft, B="0.3048")
merge = Merge(Data1=node2_6, Data2=node2_4, Data3=node2_5)  # -> flatten(Result)
merge_2 = Merge(Data1=beam_num_4, Data2=beam_num_7, Data3=beam_num_5)  # -> flatten(Result)
merge_3 = Merge(Data1=node1_6, Data2=node1_4, Data3=node1_5)  # -> flatten(Result)
index_to_cull = NodeNum(mindex.Index)
pts = Pts(multiplication)
storey_height_2 = StoreyHeight(storey_height)
index_to_cull_2 = IndexToCull(index_to_cull)
index_to_cull_3 = IndexToCull(index_to_cull)
beam_num_8 = BeamNum(merge_2)
node2_7 = Node2(merge)
node1_7 = Node1(merge_3)
cull_i = CullIndex(List=pts, Indices=index_to_cull_2, Wrap=True)
cull_i_2 = CullIndex(List=node_num_3, Indices=index_to_cull_3, Wrap=True)
series = Series(Start="0", Step=storey_height_2, Count="10")
pts_2 = Pts(cull_i)
node_num_4 = NodeNum(cull_i_2)
shift = ShiftList(List=series, Shift=1, Wrap=False)
pdecon = Deconstruct(Point=pts_2)  # -> XComponent, YComponent, ZComponent
pts_3 = Pts(pts_2)
dom = ConstructDomain(DomainStart=series, DomainEnd=shift)
cull_i_3 = CullIndex(List=reverse(dom), Indices="0", Wrap=True)  # -> reverse(List)
z_coord = DataDescription(pdecon.ZComponent)
displ_of_each_floor_in_mm_2 = DisplOfEachFloor(displ_of_each_floor_in_mm)
node_domains = DataDescription(cull_i_3)
node_domains_2 = NodeDomains(node_domains)
z_coord_2 = DataDescription(z_coord)
multiplication_2 = Multiplication(A=displ_of_each_floor_in_mm_2, B=Slider(0.001, range=0..0.001))
inc = Includes(Value=flatten(z_coord_2), Domain=graft(node_domains_2))  # -> Includes, Deviation
node_num_5 = NodeNum(node_num_4)
displ_of_each_floor_in_m = DisplOfEachFloor(multiplication_2)
in_domain = DataDescription(inc.Includes)
pts_4 = Pts(pts_3)
in_domain_2 = InDomain(inc.Includes)
node_num_6 = NodeNum(node_num_5)
dispatch = Dispatch(List=pts_4, DispatchPattern=in_domain)  # -> ListA, ListB
dispatch_2 = Dispatch(List=node_num_6, DispatchPattern=in_domain_2)  # -> ListA, ListB
pts_by_floor = Pts(dispatch.ListA)
node_num_by_floor = NodeNum(dispatch_2.ListA)
displ_of_each_floor_in_m_2 = DisplOfEachFloorInM(displ_of_each_floor_in_m)
node_num_by_floor_2 = NodeNumByFloor(node_num_by_floor)
time_step_2 = TimeStep(time_step)
pts_by_floor_2 = PtsByFloor(pts_by_floor)
node2_8 = Node2(merge)
node1_8 = Node1(merge_3)
beam_num_9 = BeamNum(merge_2)
number_slider = Slider(401, range=0..1000)
pts_by_floor_3 = PtsByFloor(pts_by_floor_2)
loop_start = LoopStart(Repeat=Slider(50, range=0..100), Trigger=Toggle(True), Data=pts_by_floor_3)  # -> port, Counter, Data
displ_of_each_floor_in_m_3 = DisplOfEachFloorInM(displ_of_each_floor_in_m_2)
node_num_by_floor_3 = NodeNumByFloor(node_num_by_floor_2)
counter = TimeS(loop_start.Counter)
pts_by_floor_4 = PtsByFloor(loop_start.Data)
time_step_3 = TimeStep(time_step_2)
panel_3 = Panel(counter)
X = UnitX(Factor=displ_of_each_floor_in_m_3)
x_displ = DisplOfEachFloorInM(X)
counter_2 = Counter(counter)
pts_by_floor_5 = PtsByFloor(pts_by_floor_4)
item_16 = ListItem(List=x_displ, Index=counter_2, Wrap=True)
move = Move(Geometry=pts_by_floor_5, Motion=item_16)  # -> Geometry, Transform
time_step_4 = TimeStep(time_step_3)
time_step_5 = TimeStep(time_step_4)
buffer = TimeBuffer(Data=move.Geometry, Ms=time_step_5, UseThread=False)
node_num_by_floor_4 = NodeNumByFloor(flatten(node_num_by_floor_3))
pts_by_floor_6 = PtsByFloor(buffer)
node1_9 = Node1(node1_8)
node1_10 = Node1(node1_9)
node_num_by_floor_5 = NodeNumByFloor(flatten(node_num_by_floor_4))
node2_9 = Node2(node2_8)
loop_end = LoopEnd(port=loop_start.port, Exit=False, Data=pts_by_floor_6, TimeOutVal=0, pausedState=False, state="Constant output")
pts_by_floor_7 = PtsByFloor(flatten(pts_by_floor_6))
mindex_2 = MemberIndex(Set=node_num_by_floor_4, Member=node1_10)  # -> flatten(Index), Count
beam_num_10 = BeamNum(beam_num_9)
pts_by_floor_8 = PtsByFloor(flatten(pts_by_floor_6))
mindex_3 = MemberIndex(Set=node_num_by_floor_5, Member=node2_9)  # -> flatten(Index), Count
index = DataDescription(mindex_2.Index)
index_2 = DataDescription(mindex_3.Index)
item_17 = ListItem(List=pts_by_floor_7, Index=index, Wrap=True)  # -> graft(Item)
item_18 = ListItem(List=pts_by_floor_8, Index=index_2, Wrap=True)  # -> graft(Item)
ln = Line(StartPoint=item_17, EndPoint=item_18)
beam_frame = BeamNum(ln)
beam_num_11 = BeamNum(beam_num)
profile_2 = Profile(profile)
beam_num_12 = BeamNum(beam_num_10)
mindex_4 = MemberIndex(Set=flatten(beam_num_12), Member=beam_num_11)  # -> flatten(Index), Count
beam_frame_2 = BeamFrame(flatten(beam_frame))
profile_3 = Profile(profile_2)
index_3 = DataDescription(mindex_4.Index)
item_19 = ListItem(List=beam_frame_2, Index=index_3, Wrap=True)  # -> simplify(graft(Item))
ggsp = GgSearchProfile(Pattern=profile_3)

ggsweep = GgSweepProfile(Rail=item_19, Profile=ggsp, Cardinal=5)
sections = DataDescription(ggsweep)

preview = CustomPreview(
    Geometry=sections,
    Material={diffuse=RGB(221, 160, 221), emission=RGB(66, 48, 66), shine=0.5, specular=RGB(255, 255, 255), transparency=0})  # disabled
